% Simulink data dictionary obstacleAvoidance_data.sldd

BusActors1 = Simulink.Bus()
  NumActors: double
  Time: double
  Actors: Bus: BusActors1Actors

BusActors1Actors = Simulink.Bus()
  ActorID: double
  Position: double[1 3]
  Velocity: double[1 3]
  Roll: double
  Pitch: double
  Yaw: double
  AngularVelocity: double[1 3]

BusObjectDetections1 = Simulink.Bus()
  NumDetections: double
  IsValidTime: boolean
  Detections: Bus: BusObjectDetections1Detections

BusObjectDetections1Detections = Simulink.Bus()
  Time: double
  Measurement: double[6 1]
  MeasurementNoise: double[6 6]
  SensorIndex: double
  ObjectClassID: double
  ObjectAttributes: Bus: BusObjectDetections1DetectionsObjectAttributes
  MeasurementParameters: Bus: BusObjectDetections1DetectionsMeasurementParameters

BusObjectDetections1DetectionsMeasurementParameters = Simulink.Bus()
  Frame: Enum: drivingCoordinateFrameType
  OriginPosition: double[3 1]
  Orientation: double[3 3]
  HasVelocity: boolean

BusObjectDetections1DetectionsObjectAttributes = Simulink.Bus()
  TargetIndex: double

TimeStep = Simulink.Parameter(0.02)